# Grasshopper definition cmplx_Curvature Analysis.gh (Grasshopper 1.0.7)
# plug-ins: Pufferfish, Human

# Script Title: Curvature Analysis
# Created by: Michael Hoehn
# Last Modified: 220116
number_slider = Slider(100, range=0..100)
number_slider_2 = Slider(4, range=0..50)
genes = GenePool(
    Decimals=2,
    Maximum=100,
    Minimum=0,
    Value=[83.81872363, 74.41247943, 26.13084201, 74.93192897, 75.87283918, 45.95027405, 86.08619896, 35.19301551, 1.701786556, 85.22887504, 94.00434019, 55.81212298, 23.22995436, 30.86321532, 71.14088897, 24.10159084, 54.48558841, 67.58953853, 45.38137403, 78.94127852, 82.11639411, 47.04327111, 16.20778512, 26.75201652, 6.059673804])
planesrf = PlaneSurface(Plane=PlaneXY(0, 0, 0), XSize=number_slider, YSize=number_slider)
sdivide = DivideSurface(Surface=planesrf, UCount=number_slider_2, VCount=number_slider_2)  # -> flatten(Points), Normals, Parameters
Z = UnitZ(Factor=genes)
int = Integer(1)
move = Move(Geometry=sdivide.Points, Motion=Z)  # -> Geometry, Transform
addition = Addition(A=number_slider_2, B=int)
srfgrid = SurfaceFromPoints(Points=move.Geometry, UCount=addition, Interpolate=False)  # -> reparameterize(Surface)
countour_density = Slider(4.17, range=0..100)
edges = BrepEdges(Brep=srfgrid)  # -> Naked, Interior, NonManifold
preview = CustomPreview(Geometry=srfgrid, Material=ColourSwatch(SwatchColor=RGB(0, 0, 0)))
debrep = DeconstructBrep(Brep=srfgrid)  # -> Faces, Edges, Vertices
X = UnitX(Factor=1)
Y = UnitY(Factor=1)
item = ListItem(List=debrep.Vertices, Index=Slider(0, range=0..4), Wrap=True)
scale = Scale(Geometry=edges.Naked, Center=Point(0, 0, 0), Factor=Slider(1.01, range=0..10))  # -> Geometry, Transform
contour = Contour(Shape=srfgrid, Point=item, Direction=Y, Distance=countour_density)
contour_2 = Contour(Shape=srfgrid, Point=item, Direction=X, Distance=countour_density)
previewlw = CustomPreviewLineweights(
    Geometry=scale.Geometry,
    Shader=ColourSwatch(SwatchColor=RGB(255, 255, 255)),
    Thickness=Slider(10, range=0..10),
    Absolute=False)
amplitude = Slider(1012, range=0..10200)
density = Slider(100, range=0..400)
python = PythonScript(crv=contour_2, Density=density, Scale=amplitude)  # -> out, a, b; inputs crv: Curve, Density: Int32, Scale: Int32
# ---------- python: Python ----------
import rhinoscriptsyntax as rs
import Rhino as rc

a = []
b = []

c = rs.coercecurve(crv)
i = rc.Geometry.Interval(0,1)
rc.Geometry.Curve.Domain.SetValue(c,i)

if (Density < 2):
    Density == 2
    

ScaleFactor = -Scale

for i in range(0, Density):
    Normal = crv.CurvatureAt(i/Density)
    Point = crv.PointAt(i/Density)
    a.append(Point)
    b.append(Point + Normal*ScaleFactor)
# ---------- end python ----------
python_2 = PythonScript(crv=contour, Density=density, Scale=amplitude)  # -> out, a, b; inputs crv: Curve, Density: Int32, Scale: Int32; same code as python

intcrv = Interpolate(Vertices=python.b, Degree=3, Periodic=False, KnotStyle=1)  # -> flatten(Curve), Length, Domain
ln = Line(StartPoint=python.a, EndPoint=python.b)
intcrv_2 = Interpolate(Vertices=python_2.b, Degree=3, Periodic=False, KnotStyle=1)  # -> flatten(Curve), Length, Domain
ln_2 = Line(StartPoint=python_2.a, EndPoint=python_2.b)

loft = Loft(Curves=ln, Options={Adjust=False, Closed=False, LoftEnds=0, LoftSimp=0, LoftType=0, Rebuild=10, Refit=0.01})  # -> flatten(Loft)
loft_2 = Loft(Curves=ln_2, Options={Adjust=False, Closed=False, LoftEnds=0, LoftSimp=0, LoftType=0, Rebuild=10, Refit=0.01})  # -> flatten(Loft)

loft_3 = Loft(Curves=intcrv.Curve, Options={Adjust=False, Closed=False, LoftEnds=0, LoftSimp=0, LoftType=0, Rebuild=10, Refit=0.01})
loft_4 = Loft(Curves=intcrv_2.Curve, Options={Adjust=False, Closed=False, LoftEnds=0, LoftSimp=0, LoftType=0, Rebuild=10, Refit=0.01})

entwine = Entwine(Branch00=ln, Branch01=ln_2, FlattenInputs=True)
entwine_2 = Entwine(Branch00=intcrv.Curve, Branch01=intcrv_2.Curve, FlattenInputs=True)
entwine_3 = Entwine(Branch00=loft_3, Branch01=loft_4, FlattenInputs=True)
previewlw_2 = CustomPreviewLineweights(Geometry=entwine, Shader=ColourSwatch(SwatchColor=RGB(0, 0, 0)), Thickness=Slider(0, range=0..10), Absolute=False)
previewlw_3 = CustomPreviewLineweights(Geometry=entwine_2, Shader=ColourSwatch(SwatchColor=RGB(0, 0, 0)), Thickness=Slider(6.7852, range=0..10), Absolute=False)
preview_2 = CustomPreview(Geometry=entwine_3, Material=ColourSwatch(SwatchColor=RGBA(255, 255, 255, 46)))
parampipemsh = ParameterPipeMesh(
    Radius=0.5,
    ParametersU=[0, 0.1, 0.2, 0.3, 0.4, 0.5, 0.6, 0.7, 0.8, 0.9, 1],
    ParametersV=[0, 0.25, 0.5, 0.75, 1],
    Weighted=False,
    Lengths=False,
    Angle=0,
    Rotation=0,
    EndType=0,
    Triangulate=False)
