# Grasshopper definition Axial Mirrored Lines_WIP.gh (Grasshopper 1.0.7)
# plug-ins: Pufferfish, Human, Weaverbird

# ---- group: Randomize these
# Script Title: Sudo-random Number Generator
# Created by: Michael Hoehn
# Last Modified: 220124
number_slider = Slider(35, range=0..100)
number_slider_2 = Slider(450, range=0..1000)
number_slider_3 = Slider(1598, range=0..10000)
dom = ConstructDomain(DomainStart=Slider(123, range=0..1000), DomainEnd=Slider(273, range=0..1000))
dom_2 = ConstructDomain(DomainStart=Slider(313, range=0..1000), DomainEnd=Slider(440, range=0..1000))

# ----
box = CenterBox(Base=PlaneXY(0, 0, 0), X=number_slider, Y=number_slider, Z=number_slider)

# ----
# Script Title: Custom High-Res Recorder
# Created by: Michael Hoehn
# Last Modified: 220121
panel = Panel("E:\NFTs\Surface\srf_")
high_res_view_cap = GhPythonScript(active=Toggle(False), filePath=panel)  # -> out, a; inputs frame: Int32
# ---------- high_res_view_cap: Python ----------
import rhinoscriptsyntax as rs

if active: 
    savedLocation = filePath + str(int(frame)).zfill(4) +".png"
    rs.Command("-ViewCaptureToFile \n\"" + savedLocation + "\"\n")
# ---------- end high_res_view_cap ----------

pop3d = Populate3D(Region=box, Count=number_slider_2, Seed=number_slider_3)
random = Random(Range=dom_2, Number=1, Seed=expr("x+3", number_slider_3))
random_2 = Random(Range=dom_2, Number=1, Seed=expr("x+4", number_slider_3))
random_3 = Random(Range=dom_2, Number=1, Seed=expr("x+5", number_slider_3))
random_4 = Random(Range=dom, Number=1, Seed=expr("x+3", number_slider_3))
random_5 = Random(Range=dom, Number=1, Seed=expr("x+4", number_slider_3))
random_6 = Random(Range=dom, Number=1, Seed=expr("x+5", number_slider_3))

# ---- group: Random Vector Flip
random_7 = Random(Range=Domain(0, 1), Number=1, Seed=expr("x+10", number_slider_3))
round = Round(Number=random_7)  # -> Nearest, Floor, Ceiling
Y = UnitY(Factor=1)
rev = Reverse(Vector=Y)
filter = StreamFilter(Gate=round.Nearest, Stream0=rev, Stream1=Y)

# ----
dom_3 = ConstructDomain(DomainStart=random_2, DomainEnd=random_5)
dom_4 = ConstructDomain(DomainStart=random, DomainEnd=random_4)
dom_5 = ConstructDomain(DomainStart=random_3, DomainEnd=random_6)
random_8 = Random(Range=dom_5, Number=number_slider_2, Seed=expr("x+2", number_slider_3))
random_9 = Random(Range=dom_3, Number=number_slider_2, Seed=expr("x+1", number_slider_3))
random_10 = Random(Range=dom_4, Number=number_slider_2, Seed=number_slider_3)

random_11 = Random(Range=Domain(0, 1), Number=1, Seed=expr("x+6", number_slider_3))
round_2 = Round(Number=random_11)  # -> Nearest, Floor, Ceiling
X = UnitX(Factor=1)
rev_2 = Reverse(Vector=X)
filter_2 = StreamFilter(Gate=round_2.Nearest, Stream0=rev_2, Stream1=X)

line = LineSDL(Start=pop3d, Direction=filter, Length=random_10)
end = EndPoints(Curve=line)  # -> Start, End
pt = Point(end.End)
line_2 = LineSDL(Start=pt, Direction=filter_2, Length=random_9)

random_12 = Random(Range=Domain(0, 1), Number=1, Seed=expr("x+12", number_slider_3))
Z = UnitZ(Factor=1)
round_3 = Round(Number=random_12)  # -> Nearest, Floor, Ceiling
rev_3 = Reverse(Vector=Z)
filter_3 = StreamFilter(Gate=round_3.Nearest, Stream0=rev_3, Stream1=Z)

# ---- group: Random Vector Flip
random_13 = Random(Range=Domain(0, 1), Number=1, Seed=expr("x+11", number_slider_3))
round_4 = Round(Number=random_13)  # -> Nearest, Floor, Ceiling
Y_2 = UnitY(Factor=1)
rev_4 = Reverse(Vector=Y_2)
filter_4 = StreamFilter(Gate=round_4.Nearest, Stream0=rev_4, Stream1=Y_2)

# ----
end_2 = EndPoints(Curve=line_2)  # -> Start, End
pt_2 = Point(end_2.End)
line_3 = LineSDL(Start=pt_2, Direction=filter_3, Length=random_8)
end_3 = EndPoints(Curve=line_3)  # -> Start, End
pt_3 = Point(end_3.End)
line_4 = LineSDL(Start=pt_3, Direction=filter_4, Length=random_9)

random_14 = Random(Range=Domain(0, 1), Number=1, Seed=expr("x+13", number_slider_3))
round_5 = Round(Number=random_14)  # -> Nearest, Floor, Ceiling
X_2 = UnitX(Factor=1)
rev_5 = Reverse(Vector=X_2)
filter_5 = StreamFilter(Gate=round_5.Nearest, Stream0=rev_5, Stream1=X_2)

end_4 = EndPoints(Curve=line_4)  # -> Start, End
pt_4 = Point(end_4.End)
line_5 = LineSDL(Start=pt_4, Direction=filter_5, Length=random_9)

random_15 = Random(Range=Domain(0, 1), Number=1, Seed=expr("x+16", number_slider_3))
Z_2 = UnitZ(Factor=1)
round_6 = Round(Number=random_15)  # -> Nearest, Floor, Ceiling
rev_6 = Reverse(Vector=Z_2)
filter_6 = StreamFilter(Gate=round_6.Nearest, Stream0=rev_6, Stream1=Z_2)

end_5 = EndPoints(Curve=line_5)  # -> Start, End
pt_5 = Point(end_5.End)
line_6 = LineSDL(Start=pt_5, Direction=filter_6, Length=random_8)
merge = Merge(Data1=line, Data2=line_2, Data3=line_3, Data4=line_4, Data5=line_5, Data6=line_6)
join = JoinCurves(Curves=merge, Preserve=False)
dom_6 = ConstructDomain(DomainStart=Slider(0.068, range=0..10), DomainEnd=Slider(3.097, range=0..10))
lng = ListLength(List=join)
random_16 = Random(Range=dom_6, Number=lng, Seed=expr("x+5", number_slider_3))
parampipemsh = ParameterPipeMesh(
    Curve=join,
    Radius=random_16,
    ParametersU=[0, 0.1, 0.2, 0.3, 0.4, 0.5, 0.6, 0.7, 0.8, 0.9, 1],
    ParametersV=[0, 0.25, 0.5, 0.75, 1],
    Weighted=False,
    Lengths=invert(False),
    Angle=0,
    Rotation=0,
    EndType=1,
    Triangulate=False)
mesh = Mesh(flatten(parampipemsh))
lng_2 = ListLength(List=mesh)
dom_7 = ConstructDomain(DomainStart=0, DomainEnd=lng_2)
random_17 = Random(Range=dom_7, Number=1, Seed=2)
round_7 = Round(Number=random_17)  # -> Nearest, Floor, Ceiling
dispdexs = DispatchIndices(List=mesh, Indices=round_7.Ceiling)  # -> AtI, NotI
mesh_2 = Mesh(flatten(dispdexs.NotI))
mesh_3 = Mesh(flatten(dispdexs.AtI))
demesh = DeconstructMesh(Mesh=mesh_2)  # -> Vertices, Faces, Colours, Normals
demesh_2 = DeconstructMesh(Mesh=mesh_3)  # -> Vertices, Faces, Colours, Normals
conmesh = ConstructMesh(Vertices=demesh.Vertices, Faces=demesh.Faces, Colours=ColourSwatch(SwatchColor=RGB(227, 227, 227)))
conmesh_2 = ConstructMesh(Vertices=demesh_2.Vertices, Faces=demesh_2.Faces, Colours=ColourSwatch(SwatchColor=RGB(255, 0, 0)))
wbfacepolys = WeaverbirdsFacePolylines(Mesh=conmesh)  # -> flatten(Polygons)
wbfacepolys_2 = WeaverbirdsFacePolylines(Mesh=conmesh_2)  # -> flatten(Polygons)
previewlw = CustomPreviewLineweights(Geometry=wbfacepolys, Shader=ColourSwatch(SwatchColor=RGB(0, 0, 0)), Thickness=Slider(0, range=0..10), Absolute=False)
previewlw_2 = CustomPreviewLineweights(Geometry=wbfacepolys_2, Shader=ColourSwatch(SwatchColor=RGB(0, 0, 0)), Thickness=Slider(0, range=0..10), Absolute=False)
back = BooleanToggle(False)
createatts = CreateAttributes(LayerName="Lines_01::2", enableFullPath=True)
bake = BakeGeometry(Bake=back, Geometry=flatten([conmesh_2, conmesh]), Attributes=createatts, DeleteOldBakes=False, PreserveTrees=False)
