# Grasshopper definition cmplx_waves.gh (Grasshopper 1.0.7)
# plug-ins: Human, BH.UI.Grasshopper

getinfo = GetInfo(Component="{ .GetInfo")
# <Script name>
project_number = Panel("")
setprojectid = SetProjectID(ProjectID=project_number, Component="{ .SetProjectID")
bhom_version_used_to_create = Panel("5.1")
bhom_version_currently_installed = Panel(getinfo)

crv = Curve(<curve referenced from the Rhino model>)
explode = Explode(Curve=crv, Recursive=True)  # -> Segments, Vertices
len = Length(Curve=explode.Segments)
sort = SortList(Keys=len, ValuesA=explode.Segments)  # -> Keys, ValuesA
series = Series(Start=0, Step=Slider(0.1, range=0..1), Count=Slider(5, range=1..25))
crv_2 = Curve(<curve referenced from the Rhino model>)
item = ListItem(List=sort.ValuesA, Index=0, Wrap=True)  # -> Item, Item1
addition = Addition(A=Slider(0.175, range=0..1), B=series)
merge = Merge(Data1=item.Item, Data2=item.Item1)
eval = EvaluateCurve(Curve=reparameterize(crv_2), Parameter=addition)  # -> Point, Tangent, Angle
resolution = Slider(25, range=0..360)
crv_3 = Curve(merge)
sides = Curve(crv_3)
list_item = ListItem(List=flatten(sides), Index=0, Wrap=True)  # -> Item, Item1
resolution_2 = Slider(17, range=0..360)
divide = DivideCurve(Curve=list_item.Item1, Count=resolution, Kinks=False)  # -> Points, Tangents, Parameters
divide_2 = DivideCurve(Curve=list_item.Item, Count=resolution, Kinks=False)  # -> Points, Tangents, Parameters
ln = Line(StartPoint=divide_2.Points, EndPoint=reverse(divide.Points))
divide_3 = DivideCurve(Curve=ln, Count=resolution_2, Kinks=False)  # -> Points, Tangents, Parameters
pt = Point(divide_3.Points)
lng = ListLength(List=pt)
series_2 = Series(Start=1, Step=1, Count=expr("X-2", lng))
magnitude = Slider(39.92, range=0..100)
attractor_points = Point(flatten(eval.Point))
item_2 = ListItem(List=pt, Index=series_2, Wrap=False)  # -> graft(Item)
pts_to_be_moved = Point(graft(item_2))
multiplication = Multiplication(A=Slider(0.355, range=0..1), B=magnitude)
vec2pt = Vector2Pt(PointA=attractor_points, PointB=pts_to_be_moved, Unitize=False)  # -> Vector, Length
graph = GraphMapper(vec2pt.Length, x0=0, x1=100, y0=0, y1=1, container_name="Bezier", cpx=[0, 1, 0, 1], cpy=[1, 1, 0, 0])
multiplication_2 = Multiplication(A=multiplication, B=graph)
amp = Amplitude(Vector=vec2pt.Vector, Amplitude=multiplication_2)
ma = MassAddition(Input=amp)  # -> Result, PartialResults
devec = DeconstructVector(Vector=ma.Result)  # -> XComponent, YComponent, ZComponent
vec = VectorXYZ(XComponent=devec.XComponent, YComponent=devec.YComponent, ZComponent=0)  # -> Vector, Length
move = Move(Geometry=pts_to_be_moved, Motion=vec.Vector)  # -> Geometry, Transform
end = EndPoints(Curve=ln)  # -> Start, End
trim = TrimTree(Tree=simplify(move.Geometry), Depth=1)
pt_2 = Point(end.Start)
pt_3 = Point(end.End)
all_moved_points = Point(move.Geometry)
merge_2 = Merge(Data1=simplify(graft(pt_2)), Data2=trim, Data3=simplify(graft(pt_3)))
pline = PolyLine(Vertices=merge_2, Closed=False)
nurbs = NurbsCurve(Vertices=merge_2, Degree=3, Periodic=False)  # -> Curve, Length, Domain
rec = DataRecorder(nurbs.Curve, DataLimit=-10, RecordData=True)  # disabled
previewlw = CustomPreviewLineweights(Geometry=nurbs.Curve, Shader=ColourSwatch(SwatchColor=RGB(0, 0, 0)), Thickness=Slider(2.13, range=0..10), Absolute=False)
previewlw_2 = CustomPreviewLineweights(Geometry=rec, Shader=ColourSwatch(SwatchColor=RGB(171, 171, 171)), Thickness=Slider(0, range=0..10), Absolute=False)
